# Grasshopper definition GcodeSlicerEXAMPLE.gh (Grasshopper 1.0.7)

geo_to_print = Curve(<curve referenced from the Rhino model>)
ordered_points = GhPythonScript(curves=geo_to_print, segment_length=Slider(2, range=0..15), z_offset=Slider(2, range=0..10))  # -> a; inputs curves: list of Curve, z_offset: Int32
# ---------- ordered_points: Python ----------
__author__ = "sandb"
__version__ = "2025.05.19"

import rhinoscriptsyntax as rs

from Rhino.Geometry import Point3d

ordered_points = []

for i, crv in enumerate(curves):
    # Get curve length and divide it
    length = crv.GetLength()
    div_count = max(int(length / segment_length), 1)
    t_vals = [j / float(div_count) for j in range(div_count + 1)]
    pts = [crv.PointAt(crv.Domain.ParameterAt(t)) for t in t_vals]

    # Get start and end points
    start_pt = crv.PointAtStart
    end_pt = crv.PointAtEnd

    if i == 0:
        # Add first curve points directly
        ordered_points.extend(pts)
    else:
        # Offset end of previous curve
        end_offset = Point3d(prev_end_pt.X, prev_end_pt.Y, prev_end_pt.Z + z_offset)
        ordered_points.append(end_offset)

        # Offset start of current curve
        start_offset = Point3d(start_pt.X, start_pt.Y, start_pt.Z + z_offset)
        ordered_points.append(start_offset)

        # Add curve points
        ordered_points.extend(pts)

    # Always update for next loop
    prev_end_pt = end_pt

# Output
a = ordered_points
# ---------- end ordered_points ----------
pt = Point(ordered_points)

# ---- group: Adjust for your setup
filament_diameter = Slider(4, range=0..4)
multiplier = Slider(1, range=0..100)
layer_width = Slider(6, range=0..10)
line_width = Slider(0.4, range=0..5)
flow = Flow(layer_height=layer_width, line_width=line_width, multiplier=multiplier, filament_diameter=filament_diameter)

# ---- group: Calculating Length of Segments
pline = PolyLine(Vertices=pt, Closed=False)
explode = Explode(Curve=pline, Recursive=True)  # -> Segments, Vertices
len = Length(Curve=explode.Segments)

# ----
multiplication = Multiplication(A=len, B=flow)

# ---- group: G-Code Splicer
speed_mm_min = Slider(25, range=0..1000)
z_offset = Slider(0, range=0..10)
pdecon = Deconstruct(Point=pt)  # -> XComponent, YComponent, ZComponent
mm_min = Multiplication(A=speed_mm_min, B=60)
e_val = Number(multiplication)
X = Text(" X")
Y = Text(" Y")
E = Text(" E")
Z = Text(" Z")
F = Text("F")
g1 = Text("G1 ")
addition = Addition(A=pdecon.ZComponent, B=z_offset)
concat = Concatenate(
    FragmentH=g1,
    FragmentG=F,
    FragmentL=mm_min,
    FragmentA=X,
    FragmentB=pdecon.XComponent,
    FragmentC=Y,
    FragmentD=pdecon.YComponent,
    FragmentE=Z,
    FragmentF=addition,
    FragmentJ=E,
    FragmentK=e_val)

# ----
mass_addition = MassAddition(Input=multiplication)  # -> Result, PartialResults
total_extrusion_mm = Panel(mass_addition.Result)
starting_g_code = Panel("""G28
G1 Z20 F1200
G21
G90
M83
G92 E0""")
ending_g_code = Panel("""G91
G1 Z10 F900
G90
G28 X0 Y0
M84""")
entwine = Entwine(Branch00=starting_g_code, Branch01=concat, Branch02=ending_g_code, FlattenInputs=True)  # -> flatten(Result)
save_to_file = GhPythonScript(lines=entwine, path="your file path", write=Toggle(False))  # -> out; inputs lines: list
# ---------- save_to_file: Python ----------
__author__ = "sandb"
__version__ = "2025.05.18"

import rhinoscriptsyntax as rs
import re

def round_gcode_line(line, precision=3):
    def replacer(match):
        num = float(match.group(0))
        return "{0:.{1}f}".format(num, precision)
    
    return re.sub(r"(?<=[XYZEFxyzef])(-?\d+\.?\d*)", replacer, line)

if write:
    try:
        cleaned_lines = [round_gcode_line(line) for line in lines]
        with open(path, 'w') as f:
            for line in cleaned_lines:
                f.write(line.strip() + '\n')
        print("✅ G-code written to: {}".format(path))
    except Exception as e:
        print("⚠️ Error writing file: {}".format(e))
else:
    print("️ Waiting for button press...")
# ---------- end save_to_file ----------
panel = Panel(save_to_file)

# ==== cluster Flow
filament_diameter = ClusterInput()
layer_height = ClusterInput()
line_width = ClusterInput()
multiplier = ClusterInput()
division = Division(FilamentDiameter=filament_diameter, B=2)
multiplication = Multiplication(LayerHeight=layer_height, LineWidth=line_width, Multiplier=multiplier)
sqr = Square(Value=division)
pi = Pi(Factor=sqr)
division_2 = Division(A=multiplication, B=pi)
R = ClusterOutput(division_2)
